# Grasshopper definition 190310.gh (Grasshopper 0.9.76)
# plug-ins: BH.UI.Grasshopper, ElkGHComponents

panel = Panel("C:\Users\SESOFMAL\Downloads\map (1).osm")

mongoadapter = MongoAdapter(
    ServerName="mongodb://localhost",
    Port=27017,
    DatabaseName="Vitboken",
    CollectionName="Topography",
    UseHistory=True,
    Component="{ ..ctor")
pull = Pull(Adapter=mongoadapter, Active=Toggle(True), Component="{ .Pull")
explode = Explode(Object=pull, Component="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")  # -> X, Y, Z
construct_point = ConstructPoint(XCoordinate=explode.X, YCoordinate=explode.Y, ZCoordinate=explode.Z)
negative = Negative(Value=Slider(1000, range=0..1000))
delaunay_mesh = DelaunayMesh(Points=construct_point, Plane=PlaneXY(0, 0, 0))
unit_z = UnitZ(Factor=negative)
move = Move(Geometry=delaunay_mesh, Motion=unit_z)  # -> Geometry, Transform

location = Location(FilePathText=panel)  # -> OSMPointData, OSMFile, LongitudeDomain, LatitudeDomain
curve = Curve()
project = Project(Direction=Vector(0, 0, 1))
curve_2 = Curve([<curve referenced from the Rhino model> x498])
area = Area(Geometry=curve_2)  # -> Area, Centroid
mesh = Mesh(simplify(Tree({0;0;0}: [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], {0;1;0}: [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], {0;2;0}: [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], {0;3;0}: [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], {0;4;0}: [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])))
osm_data = OSMData(OSMPointData=location.OSMPointData, OSMFilePath=panel, Feature="building", Generate3d=False, IndividualOutputs=False)  # -> Ways, FeatureKey
panel_2 = Panel(osm_data.FeatureKey)
mesh_2 = Mesh(simplify(mesh))
clean_tree = CleanTree(RemoveNulls=True, RemoveInvalid=True, RemoveEmpty=False, Tree=area.Centroid)
custom_preview = CustomPreview(Geometry=mesh_2, Shader=ColourSwatch(SwatchColor=RGB(255, 255, 255)))
polyline = PolyLine(Vertices=osm_data.Ways, Closed=False)
number_slider = Slider(1000, range=0..1000)
createboundary = CreateBoundary(M=mesh_2)
circle = Circle(Plane=clean_tree, Radius=Slider(308, range=0..1000))
garden_size = Panel("""16000
5995""")
corner_radius = Panel("8000")
min_nr_of_houses_in_row = Panel("3")
number_slider_2 = Slider(100, range=0..100)
closed = Closed(Curve=polyline)  # -> Closed, Periodic
unit_z_2 = UnitZ(Factor=1)
seednsimplify = SeedNsimplify(geo=createboundary, z=Slider(2, range=0..10))
unit_z_3 = UnitZ(Factor=Slider(10, range=0..10))
cull_pattern = CullPattern(List=polyline, CullPattern=closed.Closed)
boundary_surfaces = BoundarySurfaces(Edges=circle)
extrude = Extrude(Base=circle)  # disabled
crv = Curve(seednsimplify)
extrude_2 = Extrude(Base=cull_pattern, Direction=unit_z_3)
lines = Lines(A=min_nr_of_houses_in_row, L=garden_size, C=crv, x=corner_radius)
extrude_3 = Extrude(Base=boundary_surfaces, Direction=unit_z_2)  # disabled
crv_2 = Curve(flatten(crv))
data = Data(garden_size)
panel_3 = Panel()
cap_holes = CapHoles(Brep=extrude_2)
cluster = Cluster(rotangles=panel_3, midpts=panel_3, gardens=panel_3, garden_size=data, boundaries=crv_2, line=lines)  # -> rotangles_2, midpts_2, houses, newregions, newlines
scale = Scale(Geometry=cap_holes, Center=Point(0, 0, 0), Factor=Slider(1000, range=0..1000))  # -> Geometry, Transform
point = Point(Point(729719.1774, 262764.7064, 0))
point_2 = Point(Point(198077.9453, 85476.18521, 0))
cluster_2 = Cluster(
    rotangles=cluster.rotangles_2,
    midpts=cluster.midpts_2,
    gardens=cluster.houses,
    garden_size=data,
    boundaries=cluster.newregions,
    line=cluster.newlines)  # -> rotangles_2, midpts_2, houses, newregions, newlines
custom_preview_2 = CustomPreview(Geometry=move.Geometry, Shader=ColourSwatch(SwatchColor=RGBA(196, 196, 196, 202)))
vector_2pt = Vector2Pt(PointA=point, PointB=point_2, Unitize=False)  # -> Vector, Length
move_2 = Move(Geometry=scale.Geometry, Motion=vector_2pt.Vector)  # -> Geometry, Transform
cluster_3 = Cluster(
    rotangles=cluster_2.rotangles_2,
    midpts=cluster_2.midpts_2,
    gardens=cluster_2.houses,
    garden_size=data,
    boundaries=cluster_2.newregions,
    line=cluster_2.newlines)  # -> rotangles_2, midpts_2, houses, newregions, newlines
cluster_4 = Cluster(
    rotangles=cluster_3.rotangles_2,
    midpts=cluster_3.midpts_2,
    gardens=cluster_3.houses,
    garden_size=data,
    boundaries=cluster_3.newregions,
    line=cluster_3.newlines)  # -> rotangles_2, midpts_2, houses, newregions, newlines
cluster_5 = Cluster(
    rotangles=cluster_4.rotangles_2,
    midpts=cluster_4.midpts_2,
    gardens=cluster_4.houses,
    garden_size=data,
    boundaries=cluster_4.newregions,
    line=cluster_4.newlines)  # -> rotangles_2, midpts_2, houses, newregions, newlines
# vitboken-shard-00-02-fckvg.mongodb.net:27017 --ssl --username erikforsberg95@hotmail.com --password Techdays-19 --authenticationDatabase admin
# mongoimport --host Vitboken-shard-0/vitboken-shard-00-00-fckvg.mongodb.net:27017,vitboken-shard-00-01-fckvg.mongodb.net:27017,vitboken-shard-00-02-fckvg.mongodb.net:27017 --ssl --username <USERNAME> --password <PASSWORD> --authenticationDatabase admin --db <DATABASE> --collection <COLLECTION> --type <FILETYPE> --file <FILENAME>
number_slider_3 = Slider(6000, range=0..10000)
cull_i = CullIndex(List=cluster_5.midpts_2, Indices=0, Wrap=True)
cull_i_2 = CullIndex(List=cluster_5.houses, Indices=0, Wrap=True)
cull_i_3 = CullIndex(List=cluster_5.rotangles_2, Indices=0, Wrap=True)
geo = Geometry(mesh_2)
cluster_6 = Cluster_2(data_2=cull_i_2, geo=geo, data=number_slider_3)  # -> B, P
cluster_7 = Cluster_4(geo_2=cluster_5.newregions, geo=geo)
geo_2 = Geometry(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)
mongoadapter_2 = MongoAdapter(DatabaseName="project", CollectionName="bhomObjects", UseHistory=False, Component="{ ..ctor")
cluster_8 = Cluster_3(geo=geo_2, D=cull_i_3, data=cluster_6.P)
geo_3 = Geometry(cluster_8)
mongoadapter_3 = MongoAdapter(
    ServerName="mongodb://localhost",
    Port=27017,
    DatabaseName="project",
    CollectionName="bhomObjects",
    UseHistory=True,
    Component="{ ..ctor")
bhomgeo = BHoMGeometry(geo_3)
push = Push(Adapter=mongoadapter_3, Objects=bhomgeo, Active=Toggle(True), Component="{ .Push")  # -> Objects, Success
panel_4 = Panel(push.Success)

# ==== cluster Cluster
garden_size = ClusterInput()
boundaries = ClusterInput()
line = ClusterInput()
item = ListItem(List=garden_size, Index=0, Wrap=True)  # -> Item, Item1
geo = Geometry(flatten(boundaries))
cull_i = CullIndex(List=line, Indices=0, Wrap=True)
item_2 = ListItem(List=line, Index=0, Wrap=True)
rectangle = Rectangle(Plane=PlaneXY(0, 0, 0), XSize=item.Item, YSize=item.Item1, Radius=0)  # -> Rectangle, Length
len = Length(Curve=item_2)
num = Number(item.Item1)
data = Data(rectangle.Rectangle)
getplacement = CSharpScript(
    line=item_2,
    minAmount=Slider(3, range=0..10),
    maxAmount=Slider(7, range=0..10),
    segmentLength=num,
    spaceDist=Slider(8000, range=0..10000))  # -> points, lineCombinations; inputs line: Line, minAmount: Double, maxAmount: Double, segmentLength: Double, spaceDist: Double
# ---------- getplacement: C# ----------
    //========================================================
    //Declaration - fixed values
    //========================================================
    double lineLength = line.Length;
    Point3d startPt = line.From;
    Vector3d vec = (line.Direction) / lineLength;
    Vector3d husVec = vec * segmentLength;
    Vector3d spaceVec = vec * (spaceDist + segmentLength);

    //========================================================
    //Declaration - lists and new objects
    //========================================================
    Line currLine = new Line();
    Point3d currPt = new Point3d();
    List<Point3d> pointPos = new List<Point3d>();
    List<Line> lineCombination = new List<Line>();

    currPt = startPt;
    double currLength = segmentLength;
    int i = 0;
    while (currLength < lineLength)
    {
      currLine = new Line(currPt, husVec);
      currPt = currLine.To;
      pointPos.Add(currPt);
      lineCombination.Add(currLine);
      currLength = currLength + segmentLength;
      i = i + 1;

      //if i = max amunt: add spaceDist and reset counter.
      // Todo: add a new branch
      if (i == maxAmount)
      {
        currLine = new Line(currPt, spaceVec);
        currPt = currLine.To;
        currLength = currLength + spaceDist + segmentLength;
        i = 0;
      }
    }

    //========================================================
    // Remove lines that are too short. minAmount * segmentLength
    //========================================================
    if (i < minAmount)
    {
      lineCombination.RemoveRange(lineCombination.Count - i, i);
    }

    points = pointPos;
    lineCombinations = lineCombination;
# ---------- end getplacement ----------
panel = Panel(len)
vec = Vector(item_2)
getrotangle = GetRotAngle(vec=vec)
placegarden = PlaceGarden(G=data, A=getrotangle, pt=getplacement.points)  # -> G_2, X
boundary = Geometry(geo)
checkintersecs = CheckIntersecs(geo=boundary, data=placegarden.G_2)
cull_cutted = CullCutted(G_2=data, G=checkintersecs)
geo_2 = Geometry(geo)
data_2 = Data(data)
trimregions = TrimRegions(geo=geo_2, C=checkintersecs)
cull = CullPattern(List=checkintersecs, CullPattern=cull_cutted)
area = Area(Geometry=cull)  # -> Area, Centroid
data_3 = Data(getrotangle)
deg = Degrees(Radians=data_3)
lng = ListLength(List=area.Centroid)
rotangles = ClusterInput()
gardens = ClusterInput()
midpts = ClusterInput()
repeat = RepeatData(Data=deg, Length=lng)  # -> flatten(Data)
data_4 = Data(flatten(area.Centroid))
data_5 = Data(gardens)
data_6 = Data(rotangles)
data_7 = Data(midpts)
lng_2 = ListLength(List=data_7)
lng_3 = ListLength(List=data_6)
lng_4 = ListLength(List=data_5)
ins = InsertItems(List=data_5, Item=flatten(cull), Indices=lng_4, Wrap=False)
ins_2 = InsertItems(List=data_6, Item=repeat, Indices=lng_3, Wrap=False)
ins_3 = InsertItems(List=data_7, Item=data_4, Indices=lng_2, Wrap=False)
data_8 = Data(cull_i)
newregions = ClusterOutput(trimregions)
newlines = ClusterOutput(data_8)
rotangles_2 = ClusterOutput(ins_2)
midpts_2 = ClusterOutput(ins_3)
houses = ClusterOutput(ins)

# ==== cluster Lines
C = ClusterInput()
x = ClusterInput()
explode = Explode(Curve=C, Recursive=True)  # -> Segments, Vertices
A = ClusterInput()
L = ClusterInput()
neg = Negative(Value=x)
ext = ExtendCurve(Curve=explode.Segments, Type=0, Start=neg, End=neg)
item = ListItem(List=L, Index=1, Wrap=True)
jitter = Jitter(List=ext, Jitter=1, Seed=2)  # -> simplify(Values), Indices
multiplication = Multiplication(A=A, B=item)
len = Length(Curve=jitter.Values)
smaller = SmallerThan(FirstNumber=multiplication, SecondNumber=len)  # -> SmallerThan, OrEqualTo
cull = CullPattern(List=jitter.Values, CullPattern=smaller.SmallerThan)
L_2 = ClusterOutput(cull)

# ==== cluster CreateBoundary
M = ClusterInput()
medges = MeshEdges(Mesh=M)  # -> NakedEdges, InteriorEdges, NonManifoldEdges
geo = Geometry(medges.NakedEdges)
join = JoinCurves(Curves=medges.NakedEdges, Preserve=False)  # -> flatten(Curves)
project = Project(Geometry=join, Plane=PlaneXY(0, 0, 0))  # -> Geometry, Transform
simplify = SimplifyCurve(Curve=project.Geometry)  # -> Curve, Simplified
flip = FlipCurve(Curve=simplify.Curve, Guide=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)  # -> Curve, Flag
data = Data(flip.Curve)
data_2 = ClusterOutput(data)

# ==== cluster Cluster_2
data = ClusterInput()
data_2 = ClusterInput()
geo = ClusterInput()
data_3 = Data(data)
data_4 = Data(data_2)
geo_2 = Geometry(geo)
mjoin = MeshJoin(Meshes=flatten(geo_2))
area = Area(Geometry=data_4)  # -> Area, Centroid
project = ProjectPoint(Point=area.Centroid, Direction=Vector(0, 0, 1), Geometry=mjoin)  # -> Point, Index
clean = CleanTree(RemoveNulls=True, RemoveInvalid=True, RemoveEmpty=False, Tree=area.Centroid)  # -> flatten(Tree)
clean_2 = CleanTree(RemoveNulls=True, RemoveInvalid=True, RemoveEmpty=False, Tree=project.Point)  # -> flatten(Tree)
pt = Point(project.Point)
flatten = FlattenTree(Tree=clean_2, Path="{0}")
cullpt = CullDuplicates(Points=flatten(pt), Tolerance=expr("0.01", 0.1), CullMode=3)  # -> Points, Indices, Valence
vec2pt = Vector2Pt(PointA=clean, PointB=flatten, Unitize=False)  # -> Vector, Length
P = ClusterOutput(cullpt.Points)
move = Move(Geometry=data_4, Motion=vec2pt.Vector)  # -> Geometry, Transform
Z = UnitZ(Factor=data_3)
extr = Extrude(Base=move.Geometry, Direction=Z)
capex = CapHolesEx(Brep=extr)  # -> Brep, Caps, Solid
B = ClusterOutput(capex.Brep)

# ==== cluster Cluster_3
geo = ClusterInput()
geo_2 = Geometry(geo)
bbox = BoundingBox(Content=geo_2, Plane=PlaneXY(0, 0, 0))  # -> Box, Box_2
box = EvaluateBox(Box=bbox.Box, UParameter=0.5, VParameter=0.5, WParameter=0.5)  # -> Plane, Point, Include
data = ClusterInput()
project = Project(Geometry=box.Point, Plane=PlaneXY(0, 0, 0))  # -> Geometry, Transform
pt = Point(project.Geometry)
data_2 = Data(data)
vec2pt = Vector2Pt(PointA=pt, PointB=data_2, Unitize=False)  # -> Vector, Length
move = Move(Geometry=geo_2, Motion=vec2pt.Vector)  # -> Geometry, Transform
D = ClusterInput()
xy = XYPlane(Origin=data_2)
rad = Radians(Degrees=D)
rotate = Rotate(Geometry=move.Geometry, Angle=rad, Plane=xy)  # -> Geometry, Transform
G = ClusterOutput(rotate.Geometry)

# ==== cluster Cluster_4
geo = ClusterInput()
geo_2 = ClusterInput()
geo_3 = Geometry(geo)
geo_4 = Geometry(geo_2)
offset = OffsetCurve(Curve=geo_4, Distance=expr("-5000", 1), Plane=PlaneXY(0, 0, 0), Corners=1)
area = Area(Geometry=offset)  # -> expr("x/1000000000", Area), Centroid
round = Round(Number=area.Area)  # -> Nearest, Floor, Ceiling
pop2d = Populate2D(Region=offset, Count=round.Ceiling, Seed=1)
project = ProjectPoint(Point=pop2d, Direction=unitize(Vector(0, 0, 1)), Geometry=geo_3)  # -> Point, Index
P = ClusterOutput(project.Point)

# ==== cluster SeedNsimplify
geo = ClusterInput()
geo_2 = Geometry(geo)
explode = Explode(Curve=geo_2, Recursive=True)  # -> Segments, simplify(Vertices)
end = EndPoints(Curve=explode.Segments)  # -> Start, End
shift = ShiftList(List=explode.Segments, Shift=1, Wrap=True)
dprod = DotProduct(VectorA=unitize(explode.Segments), VectorB=unitize(shift), Unitize=False)  # -> simplify(DotProduct)
smaller = SmallerThan(FirstNumber=dprod, SecondNumber=Slider(0.872, range=0..1))  # -> SmallerThan, OrEqualTo
geo_3 = Geometry(graft(geo_2))
cull = CullPattern(List=end.End, CullPattern=smaller.SmallerThan)
crv_cp = CurveClosestPoint(Point=simplify(cull), Curve=reparameterize(geo_3))  # -> Point, simplify(Parameter), Distance
z = ClusterInput()
python = GhPythonScript(x=crv_cp.Parameter, y=Slider(0.93, range=0..10), z=z)  # -> out, a; inputs x: list
# ---------- python: Python ----------
__author__ = "Erik"
__version__ = "2019.03.06"

import rhinoscriptsyntax as rs
import ghpythonlib.components as gh
import random

t = x
fac = y
t.append(float(0))
t.append(float(1))
newT = gh.SortList(t,t)[1]
t = gh.SortList(t,t)[1]
b = t
for i in range(0, len(t)-1):
    thisT = t[i]
    nextT = t[i+1]
    diff = nextT-thisT
    if diff > 1/6:
        newT.append(thisT+diff/2)
t2 = gh.SortList(newT,newT)[1]
for i in range(0, len(t2)-1):
    thisT = t2[i]
    nextT = t2[i+1]
    diff = nextT-thisT
    if random.uniform(0,1)/fac < diff:
        newPt = random.normalvariate(1,0.1)*diff/2
        newT.append(thisT+newPt)
a = gh.SortList(newT,newT)[1]
# ---------- end python ----------
cull_i = CullIndex(List=python.a, Indices=0, Wrap=True)
eval = EvaluateCurve(Curve=reparameterize(geo_3), Parameter=cull_i)  # -> Point, Tangent, Angle
pline = PolyLine(Vertices=eval.Point, Closed=True)
pl = ClusterOutput(pline)

# ==== cluster GetRotAngle
vec = ClusterInput()
vec_2 = Vector(vec)
devec = DeconstructVector(Vector=vec_2)  # -> flatten(XComponent), YComponent, ZComponent
larger = LargerThan(FirstNumber=devec.XComponent, SecondNumber=0)  # -> LargerThan, OrEqualTo
angle = Angle(VectorA=Vector(0, 1, 0), VectorB=vec_2)  # -> flatten(Angle), flatten(Reflex)
p_n_c = PickNChoose(Pattern=larger.LargerThan, Stream0=angle.Angle, Stream1=angle.Reflex)  # -> graft(Result)
num = Number(p_n_c)
match = MatchTree(Tree=num, Guide=vec_2)
angle_2 = ClusterOutput(match)

# ==== cluster PlaceGarden
G = ClusterInput()
A = ClusterInput()
pt = ClusterInput()
pt_2 = Point(pt)
origin = Point(Point(0, 0, 0))
vec2pt = Vector2Pt(PointA=origin, PointB=pt_2, Unitize=False)  # -> Vector, Length
move = Move(Geometry=G, Motion=vec2pt.Vector)  # -> Geometry, Transform
xy = XYPlane(Origin=pt_2)
transform = Transform(flatten(move.Transform))
rotate = Rotate(Geometry=simplify(move.Geometry), Angle=expr("x+pi", simplify(graft(A))), Plane=simplify(xy))  # -> Geometry, Transform
transform_2 = Transform(flatten(rotate.Transform))
transform_3 = Transform(graft(transform_2))
transform_4 = Transform(graft(transform))
comp = Compound(Transforms=[transform_4, transform_3])  # -> flatten(Compound)
G_2 = ClusterOutput(rotate.Geometry)
X = ClusterOutput(comp)

# ==== cluster CheckIntersecs
data = ClusterInput()
geo = ClusterInput()
data_2 = Data(simplify(data))
geo_2 = Geometry(geo)
match = MatchTree(Tree=graft(geo_2), Guide=data_2)
rint = RegionIntersection(CurvesA=data_2, CurvesB=match, Plane=PlaneXY(0, 0, 0))  # -> simplify(Result)
len = Length(Curve=rint)
larger = LargerThan(FirstNumber=len, SecondNumber=Slider(1000, range=0..1000))  # -> LargerThan, OrEqualTo
cull = CullPattern(List=rint, CullPattern=larger.LargerThan)
data_3 = Data(cull)
data_4 = ClusterOutput(data_3)

# ==== cluster CullCutted
G = ClusterInput()
G_2 = ClusterInput()
area = Area(Geometry=G)  # -> Area, Centroid
area_2 = Area(Geometry=G_2)  # -> Area, Centroid
subtraction = Subtraction(A=area_2.Area, B=area.Area)
abs = Absolute(Value=subtraction)
smaller = SmallerThan(FirstNumber=abs, SecondNumber=1)  # -> SmallerThan, OrEqualTo
data = Data(smaller.OrEqualTo)
data_2 = ClusterOutput(data)

# ==== cluster TrimRegions
C = ClusterInput()
data = Data(C)
divide = DivideCurve(Curve=C, Count=2, Kinks=True)  # -> simplify(Points), Tangents, Parameters
path_mapper = PathMapper(divide.Points, source="{A;B}", target="{A}")
geo = ClusterInput()
cullpt = CullDuplicates(Points=path_mapper, Tolerance=0.001, CullMode=3)  # -> Points, Indices, Valence
hull = ConvexHull(Points=cullpt.Points, Plane=PlaneXY(0, 0, 0))  # -> Hull, HullZ, Indices
geo_2 = Geometry(graft(geo))
offset = OffsetCurve(Curve=hull.Hull, Distance=Slider(100, range=0..100), Plane=PlaneXY(0, 0, 0), Corners=1)
match = MatchTree(Tree=geo_2, Guide=offset)
xy = XYPlane(Origin=Point(0, 0, 0))
rdiff = RegionDifference(CurvesA=match, CurvesB=offset, Plane=xy)  # -> simplify(Result)
area = Area(Geometry=rdiff)  # -> Area, Centroid
sort = SortList(Keys=area.Area, ValuesA=rdiff)  # -> Keys, ValuesA
item = ListItem(List=sort.ValuesA, Index=-1, Wrap=True)
i = ClusterOutput(item)
