# Grasshopper definition HousePacking.gh (Grasshopper 1.0.7)

# ----
# Variation as a parameter to evaluate?
# House types, length spread, orientations
# 
# Ensure the vectors always point towards centre
# 
# How to flip house rows?
# 
# vad ska komma först - husen eller övriga areor (green area, parking etc)?
# Ska vi implementera forst fit på övriga areor om husen placeras först?
# 1. Create Set
# A
# B
# C
panel = Panel("""12
7""")
panel_2 = Panel("""14
9""")
panel_3 = Panel("""18
10""")
item = ListItem(List=panel, Index=0, Wrap=True)  # -> Item, Item1
item_2 = ListItem(List=panel_2, Index=0, Wrap=True)  # -> Item, Item1
item_3 = ListItem(List=panel_3, Index=0, Wrap=True)  # -> Item, Item1
rectangle = Rectangle(Plane=PlaneXY(0, 0, 0), XSize=item.Item, YSize=item.Item1, Radius=0)  # -> Rectangle, Length
rectangle_2 = Rectangle(Plane=PlaneXY(0, 0, 0), XSize=item_2.Item, YSize=item_2.Item1, Radius=0)  # -> Rectangle, Length
rectangle_3 = Rectangle(Plane=PlaneXY(0, 0, 0), XSize=item_3.Item, YSize=item_3.Item1, Radius=0)  # -> Rectangle, Length
merge = Merge(Data1=rectangle.Rectangle, Data2=rectangle_2.Rectangle, Data3=rectangle_3.Rectangle)

# ----
# 2. Select houses
# 3. Define site boundaries
number_slider = Slider(3, range=0..3)
filter = StreamFilter(
    Gate=number_slider,
    Stream0=rectangle.Rectangle,
    Stream1=rectangle_2.Rectangle,
    Stream2=rectangle_3.Rectangle,
    Stream3=merge)

number_slider_2 = Slider(8, range=0..10)
number_slider_3 = Slider(6, range=0..10)
seed = Slider(7, range=0..10)
number_slider_4 = Slider(0, range=0..10)
corner_radius = Slider(10, range=0..10)
geo = Geometry([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])

lng = ListLength(List=merge)
dom = ConstructDomain(DomainStart=0, DomainEnd=lng)
random = Random(Range=dom, Number=1, Seed=Slider(1, range=0..10))
round = Round(Number=random)  # -> Nearest, Floor, Ceiling
rectangle_4 = Geometry(filter)
item_4 = ListItem(List=rectangle_4, Index=round.Nearest, Wrap=True)

item_5 = ListItem(List=rectangle_4, Index=Slider(2, range=0..10), Wrap=True)
item_6 = ListItem(List=rectangle_4, Index=Slider(3, range=0..10), Wrap=True)

srf = Surface(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)
scale = Scale(Geometry=srf, Center=Point(0, 0, 0), Factor=Slider(0.001, range=0..0.001))  # -> Geometry, Transform

cluster = Cluster(
    bounds=geo,
    rectangle=item_5,
    minamount=number_slider_2,
    maxamount=number_slider_3,
    spacedist=number_slider_4,
    seed=seed,
    cornerrad=corner_radius)  # -> R_2, R, tanvec
area = Area(Geometry=cluster.R_2)  # -> Area, Centroid
bnd = Bounds(Numbers=area.Area)
dedomain = DeconstructDomain(Domain=bnd)  # -> Start, End
equals = Equality(FirstNumber=area.Area, SecondNumber=dedomain.End)  # -> Equality, Inequality
cull = CullPattern(List=cluster.R_2, CullPattern=equals.Equality)
disc = Discontinuity(Curve=cull, Level=1)  # -> Points, Parameters
pline = PolyLine(Vertices=disc.Points, Closed=True)
cluster_2 = Cluster(
    bounds=pline,
    rectangle=item_4,
    minamount=number_slider_2,
    maxamount=number_slider_3,
    spacedist=number_slider_4,
    seed=seed,
    cornerrad=corner_radius)  # -> R_2, R, tanvec
area_2 = Area(Geometry=cluster_2.R_2)  # -> Area, Centroid
bnd_2 = Bounds(Numbers=area_2.Area)
dedomain_2 = DeconstructDomain(Domain=bnd_2)  # -> Start, End
equals_2 = Equality(FirstNumber=area_2.Area, SecondNumber=dedomain_2.End)  # -> Equality, Inequality
cull_2 = CullPattern(List=cluster_2.R_2, CullPattern=equals_2.Equality)
item_7 = ListItem(List=cull_2, Index=0, Wrap=True)  # -> flatten(Item)
disc_2 = Discontinuity(Curve=item_7, Level=1)  # -> Points, Parameters
pline_2 = PolyLine(Vertices=disc_2.Points, Closed=True)
cluster_3 = Cluster(
    bounds=pline_2,
    rectangle=item_4,
    minamount=number_slider_2,
    maxamount=number_slider_3,
    spacedist=number_slider_4,
    seed=seed,
    cornerrad=corner_radius)  # -> R_2, R, tanvec
area_3 = Area(Geometry=cluster_3.R_2)  # -> Area, Centroid
bnd_3 = Bounds(Numbers=area_3.Area)
dedomain_3 = DeconstructDomain(Domain=bnd_3)  # -> Start, End
equals_3 = Equality(FirstNumber=area_3.Area, SecondNumber=dedomain_3.End)  # -> Equality, Inequality
cull_3 = CullPattern(List=cluster_3.R_2, CullPattern=equals_3.Equality)
item_8 = ListItem(List=cull_3, Index=0, Wrap=True)  # -> flatten(Item)
disc_3 = Discontinuity(Curve=item_8, Level=1)  # -> Points, Parameters
pline_3 = PolyLine(Vertices=disc_3.Points, Closed=True)
cluster_4 = Cluster(
    bounds=pline_3,
    rectangle=item_4,
    minamount=number_slider_2,
    maxamount=number_slider_3,
    spacedist=number_slider_4,
    seed=seed,
    cornerrad=corner_radius)  # -> R_2, R, tanvec

area_4 = Area(Geometry=cluster_4.R_2)  # -> Area, Centroid
bnd_4 = Bounds(Numbers=area_4.Area)
dedomain_4 = DeconstructDomain(Domain=bnd_4)  # -> Start, End
equals_4 = Equality(FirstNumber=area_4.Area, SecondNumber=dedomain_4.End)  # -> Equality, Inequality
cull_4 = CullPattern(List=cluster_4.R_2, CullPattern=equals_4.Equality)

item_9 = ListItem(List=cull_4, Index=0, Wrap=True)  # -> flatten(Item)
disc_4 = Discontinuity(Curve=item_9, Level=1)  # -> Points, Parameters
pline_4 = PolyLine(Vertices=disc_4.Points, Closed=True)
cluster_5 = Cluster(
    bounds=pline_4,
    rectangle=item_4,
    minamount=number_slider_2,
    maxamount=number_slider_3,
    spacedist=number_slider_4,
    seed=seed,
    cornerrad=corner_radius)  # -> R_2, R, tanvec

area_5 = Area(Geometry=cluster_5.R_2)  # -> Area, Centroid
bnd_5 = Bounds(Numbers=area_5.Area)
dedomain_5 = DeconstructDomain(Domain=bnd_5)  # -> Start, End
equals_5 = Equality(FirstNumber=area_5.Area, SecondNumber=dedomain_5.End)  # -> Equality, Inequality
cull_5 = CullPattern(List=cluster_5.R_2, CullPattern=equals_5.Equality)
item_10 = ListItem(List=cull_5, Index=0, Wrap=True)  # -> flatten(Item)
disc_5 = Discontinuity(Curve=item_10, Level=1)  # -> Points, Parameters
pline_5 = PolyLine(Vertices=disc_5.Points, Closed=True)
cluster_6 = Cluster(
    bounds=pline_5,
    rectangle=item_4,
    minamount=number_slider_2,
    maxamount=number_slider_3,
    spacedist=number_slider_4,
    seed=seed,
    cornerrad=corner_radius)  # -> R_2, R, tanvec

entwine = Entwine(
    Branch00=cluster.tanvec,
    Branch01=cluster_2.tanvec,
    Branch02=cluster_3.tanvec,
    Branch03=cluster_4.tanvec,
    Branch04=cluster_5.tanvec,
    Branch05=cluster_6.tanvec,
    FlattenInputs=True)
entwine_2 = Entwine(
    Branch00=cluster.R,
    Branch01=cluster_2.R,
    Branch02=cluster_3.R,
    Branch03=cluster_4.R,
    Branch04=cluster_5.R,
    Branch05=cluster_6.R,
    FlattenInputs=True)

# ----
# OUTPUTS
housefootprint = Geometry(entwine_2)
newboundary = Geometry(cluster_6.R_2)

# ----
# Previews
number_slider_5 = Slider(5, range=0..10)
boundary = BoundarySurfaces(Edges=housefootprint)
Z = UnitZ(Factor=number_slider_5)
area_6 = Area(Geometry=merge)  # -> Area, Centroid
extr = Extrude(Base=housefootprint, Direction=Z)
bnd_6 = Bounds(Numbers=area_6.Area)
cap = CapHoles(Brep=extr)
area_7 = Area(Geometry=extr)  # -> Area, Centroid
dedomain_6 = DeconstructDomain(Domain=bnd_6)  # -> Start, End
gradient = Gradient(
    LowerLimit=dedomain_6.Start,
    UpperLimit=dedomain_6.End,
    Parameter=area_7.Area,
    stops=[0: RGB(234, 38, 0), 0.25: RGB(234, 126, 0), 0.5: RGB(254, 244, 84), 0.75: RGB(173, 203, 249), 1: RGB(75, 107, 169)])
preview = CustomPreview(Geometry=cap, Material=gradient)

# ----
# Green Areas
number_slider_6 = Slider(3, range=0..10)
offset = OffsetCurve(Curve=newboundary, Distance=number_slider_6, Plane=PlaneXY(0, 0, 0), Corners=1)
smoothpline = SmoothPolyline(Polyline=offset, Strength=Slider(1, range=0..1), Times=1)
boundary_2 = BoundarySurfaces(Edges=smoothpline)
# Cull small areas
# Create new boundaries
preview_2 = CustomPreview(Geometry=boundary_2, Material=ColourSwatch(SwatchColor=RGB(31, 130, 38)))

# ==== cluster Cluster
rectangle = ClusterInput()
bounds = ClusterInput()
cornerrad = ClusterInput()
rectangle_2 = Geometry(rectangle)
bounds_2 = Geometry(bounds)
seed = ClusterInput()
minamount = ClusterInput()
maxamount = ClusterInput()
spacedist = ClusterInput()

# ----
# Access Points, Rotation angl, rectangles
bounds_3 = SegmentBounds(Bounds=flatten(bounds_2), Rectangle=rectangle_2, Seed=seed, CornerRadius=cornerrad)  # -> AllLines, CurrentLine
createaccesspoints = PlotPlanning(Line=bounds_3.CurrentLine, MinAmount=minamount, MaxAmount=maxamount, Rectangle=rectangle_2, SpcaceDist=spacedist)  # -> simplify(AccessPts)
getorientvectors = PlotPlanning(Point=createaccesspoints, Line=graft(bounds_3.CurrentLine))  # -> TanVec, NormVec
createrectangles = PlotPlanning(BaseRectangle=rectangle_2, Position=createaccesspoints, TanVector=getorientvectors.TanVec)

line = Line(bounds_3.CurrentLine)
clean = CleanTree(RemoveNulls=True, RemoveInvalid=True, RemoveEmpty=False, Tree=createrectangles)

# ----
# Cull small areas
c_script = CSharpScript(A=clean, B=graft(bounds_2))  # -> out, simplify(R); inputs A: Curve, B: Curve
# ---------- c_script: C# ----------
    Point3d origin = new Point3d(0, 0, 0);
    Vector3d normal = new Vector3d (0, 0, 1);
    Plane p = new Plane(origin, normal);

    //Calculate start area

    Curve[] x = Rhino.Geometry.Curve.CreateBooleanIntersection(A, B, 0.001);


    double a1 = Rhino.Geometry.AreaMassProperties.Compute(x).Area;
    double a2 = Rhino.Geometry.AreaMassProperties.Compute(A).Area;

    double r1 = Math.Round(a1);
    double r2 = Math.Round(a2);

    if (r1 == r2)
    {
      R = x;
    }


    // If the area has been split it should be removed from the output list
# ---------- end c_script ----------

R = ClusterOutput(c_script.R)
tanvec = ClusterOutput(getorientvectors.TanVec)

# ----
# Create new boundaries
c_script_2 = CSharpScript(x=c_script.R)  # -> out, A; inputs x: list of Polyline
# ---------- c_script_2: C# ----------
    List <Point3d> ptList = new List <Point3d>();

    foreach (var pLine in x)
    {



      if (pLine != null)
      {
        foreach (var l in pLine.GetSegments())
        {
          ptList.Add(l.From);
          ptList.Add(l.To);
        }
      }
      A = Rhino.Geometry.Point3d.SortAndCullPointList(ptList, 0.01);
    }
# ---------- end c_script_2 ----------
xy = XYPlane(Origin=Point(0, 0, 0))

clean_2 = CleanTree(RemoveNulls=True, RemoveInvalid=True, RemoveEmpty=False, Tree=c_script_2.A)
path_mapper = PathMapper(clean_2, source="{A;B}", target="{A}")
sort_pt = SortPoints(Points=path_mapper)  # -> Points, Indices

chull = ConvexHull(Pt=sort_pt.Points)
offset = OffsetCurve(Curve=chull, Distance=Slider(12, range=0..100), Plane=PlaneXY(0, 0, 0), Corners=1)
rdiff = RegionDifference(CurvesA=graft(bounds_2), CurvesB=offset, Plane=xy)  # -> simplify(Result)

R_2 = ClusterOutput(rdiff)
